% Requirement links of Controller.slx (R2018b)

block :19 implements ControllerRequirements.slreqx#4: Right-Collision
block :25 implements ControllerRequirements.slreqx#5: Front-Collision
block :31 implements ControllerRequirements.slreqx#7: Default Driving
block :7 implements ControllerRequirements.slreqx#3: Left-Collision